# Grasshopper definition Richard_Julia_Weekly Assignment 5.gh (Grasshopper 1.0.8)

# Assignment
# Task 1: WRITE A FUNCTION THAT turns an input curve into a list of N
# lines (i.e. visually these lines should form a
# polyline that approximate the original input curve)
# 
# (Hint: You can set the curve's interval to
#  the range 0.0 - 1.0 to make the math a bit
# easier to work with)
# Task 2: (Optional) Try out various functions and properties in the Points, Vectors, and Curves class.
# 
# This task is supposed to get you a bit more familiar with these RhinoCommon features.
# 
# A possible exercise: Use script to visualise the curvature of  different curves
panel = Panel("E:\ITECH\SEMESTER 1\COMPUTATIONAL DESIGN\WEEKLY ASSIGNMENTS\WEEK 5\Richard_Julia_Weekly Assignment 5_Script.py")
# Task 3: Use what you have learnt so far to generate a geometric design. BE CREATIVE  !
# 
# You must use Curves, Points, Planes, or Curve or a combination of these.
number_slider = Slider(10, range=0..10)
read_file = ReadFile(File=panel, PerLineParse=False)
crv = Curve(<curve referenced from the Rhino model>)
python_3_script = Python3Script(script=read_file, crv=crv, N="10")  # -> out, a; inputs crv: list of Curve, N: Int32; unedited script template
curve = Curve(python_3_script.a)
panel_2 = Panel(python_3_script.a)
